# Dynamo graph hyperbolic-paraboloid.dyn "hyperbolic-paraboloid-v5" (Dynamo 2.1.0.7500)

# group: Hyperbolic Paraboloid
origin = Point.Origin()
count_slider = IntegerSlider(8, range=2..25 step 1)
height_modifier_slider = DoubleSlider(0.7, range=0..1 step 0.1)
intersect_radius_slider = DoubleSlider(0.25, range=0..2 step 0.05)
beam_diameter_slider = DoubleSlider(0.15, range=0..2 step 0.05)
code_block = CodeBlock(count=count_slider, height=height_modifier_slider, intersect=intersect_radius_slider, beam=beam_diameter_slider)
# ---------- code_block.designscript (17 lines) ----------
0..count..1;

0..count..height;

0..count..1;

count;

(count * height)..0..(height * -1);

0..1..(1/count);

intersect;

beam;

0..1..(1/count);
# ----------------------------------------
translate = Geometry.Translate(geometry=origin, xTranslation=code_block.out0, zTranslation=code_block.out1)
translate_2 = Geometry.Translate(geometry=origin, xTranslation=code_block.out2, yTranslation=code_block.count, zTranslation=code_block.out4)
byStartPointEndPoint = Line.ByStartPointEndPoint(startPoint=translate, endPoint=translate_2)
code_block_2 = CodeBlock(lines1=byStartPointEndPoint) { lines1; }
firstItem = List.FirstItem(list=byStartPointEndPoint)
lastItem = List.LastItem(list=byStartPointEndPoint)
list_create = List.Create(item0=firstItem, item1=lastItem)
pointAtParameter = Curve.PointAtParameter(curve=list_create, param=code_block.out5, lacing=CrossProduct)
code_block_3 = CodeBlock(IN=pointAtParameter) { IN[0]; IN[1]; }
byStartPointEndPoint_2 = Line.ByStartPointEndPoint(startPoint=code_block_3.out0, endPoint=code_block_3.out1)
code_block_4 = CodeBlock(lines1=code_block_2, lines2=byStartPointEndPoint_2) { lines1; lines2; }
intersectAll = Geometry.IntersectAll(geometry=code_block_4.lines1, others=code_block_4.lines2, lacing=CrossProduct)
code_block_5 = CodeBlock(start1=translate, end1=translate_2, intersect=code_block.intersect, radius=code_block.beam) { start1; end1; intersect; radius; }
code_block_6 = CodeBlock(start1=code_block_5.start1, end1=code_block_5.end1, intersect=code_block_5.intersect, radius=code_block_5.radius, start2=code_block_3.out0, end2=code_block_3.out1) { start1; end1; intersect; radius; start2; end2; radius; }
code_block_7 = CodeBlock(intersect=code_block_6.out2) { intersect; }
byCenterPointRadius = Sphere.ByCenterPointRadius(centerPoint=intersectAll, radius=code_block_7)
byPointsRadius = Cylinder.ByPointsRadius(startPoint=code_block_6.out0, endPoint=code_block_6.out1, radius=code_block_6.out3)
byPointsRadius_2 = Cylinder.ByPointsRadius(startPoint=code_block_6.out4, endPoint=code_block_6.out5, radius=code_block_6.out6)
beams = List.Create(item0=byPointsRadius, item1=byPointsRadius_2)

# group: Colour Geometry
code_block_8 = CodeBlock()
# ---------- code_block_8.designscript (4 lines) ----------
[
Color.ByARGB(255,0,0,100),
Color.ByARGB(255,100,0,100)
];
# ----------------------------------------
code_block_9 = CodeBlock(list=code_block.out8) { [0,1]; list; }
color_range = ColorRange(colors=code_block_8, indices=code_block_9.out0, value=code_block_9.list)
list_create_2 = List.Create(item0=color_range, item1=color_range)
reverse = List.Reverse(list=list_create_2@L2)
byGeometryColor = Modifiers.GeometryColor.ByGeometryColor(geometry=byCenterPointRadius, color=reverse, lacing=Longest)

# group: Colour Geometry
code_block_10 = CodeBlock()
# ---------- code_block_10.designscript (4 lines) ----------
[
Color.ByARGB(255,0,0,200),
Color.ByARGB(255,200,0,200)
];
# ----------------------------------------
code_block_11 = CodeBlock(list=code_block.out8) { [0,1]; list; }
color_range_2 = ColorRange(colors=code_block_10, indices=code_block_11.out0, value=code_block_11.list)
list_create_3 = List.Create(item0=color_range_2, item1=color_range_2)
byGeometryColor_2 = Modifiers.GeometryColor.ByGeometryColor(geometry=beams, color=list_create_3, lacing=Longest)
