# Dynamo graph hyperbolic-paraboloid-v2.dyn (Dynamo 2.1.0.7500)

# group: Hyperbolic Paraboloid
origin = Point.Origin()
number = DoubleInput(0)
distance_slider = IntegerSlider(5, range=2..25 step 1)
list_create = List.Create(item0=number, item1=distance_slider)
height_modifier_slider = DoubleSlider(0.8, range=0..1 step 0.1)
mul = distance_slider * height_modifier_slider
number_2 = DoubleInput(0)
list_create_2 = List.Create(item0=mul, item1=number_2)
translate = Geometry.Translate(geometry=origin, xTranslation=list_create, yTranslation=distance_slider, zTranslation=list_create_2)

list_create_3 = List.Create(item0=number, item1=mul)

# group (continued): Hyperbolic Paraboloid
translate_2 = Geometry.Translate(geometry=origin, xTranslation=list_create, zTranslation=list_create_3)
byStartPointEndPoint = Line.ByStartPointEndPoint(startPoint=translate_2, endPoint=translate)
byLoft = Surface.ByLoft(crossSections=byStartPointEndPoint)
